# Grasshopper definition clusters_20170314.gh (Grasshopper 0.9.76)

cleanpolyline = CleanPolyline(tolerance=0.1)  # -> flatten(crv_5)
setbackcurvesid = SetbackCurvesID()  # -> back_2, sides_2, front_2, tree_2
setbackpasser = SetbackPasser()

# ==== cluster SetbackPasser
list_of_setback_data = ClusterInput()
data_to_test = ClusterInput()
list_of_setback_data_2 = Data(list_of_setback_data)
data_to_test_2 = Data(data_to_test)
split = TextSplit(Text=list_of_setback_data_2, Separators=",")
dispatch = Dispatch(List=split, DispatchPattern=[True, False])  # -> ListA, ListB
setbacks = Data(dispatch.ListB)
heights = Data(dispatch.ListA)
shift = ShiftList(List=heights, Shift=1, Wrap=False)
pt = ConstructPoint(XCoordinate=setbacks, YCoordinate=heights, ZCoordinate=0)
short = ShortestList(ListA=setbacks, ListB=shift, TrimMode=2)  # -> ListA, ListB
panel = Panel(setbacks)
larger = LargerThan(FirstNumber=graft(data_to_test_2), SecondNumber=heights)  # -> LargerThan, OrEqualTo
pt_2 = ConstructPoint(XCoordinate=short.ListA, YCoordinate=short.ListB, ZCoordinate=0)
weave = Weave(Pattern=[0, 1], Stream0=pt, Stream1=pt_2, NullGaps=False)
dispatch_2 = Dispatch(List=simplify(panel), DispatchPattern=larger.OrEqualTo)  # -> ListA, ListB
intcrv = Interpolate(Vertices=weave, Degree=1, Periodic=False, KnotStyle=1)  # -> Curve, Length, Domain
item = ListItem(List=dispatch_2.ListA, Index=0, Wrap=True)  # -> Item1, Item
trim = TrimTree(Tree=item.Item1, Depth=1)
list_of_corresponding_heights = Data(trim)
list_of_corresponding_heights_2 = ClusterOutput(list_of_corresponding_heights)

# ==== cluster SetbackCurvesID

# ---- group: Cluster Input
lots = ClusterInput()

superlots = ClusterInput()

# ----
superlots_2 = Curve(superlots)
lots_2 = Curve(lots)
explode = Explode(Curve=lots_2, Recursive=True)  # -> Segments, Vertices
panel = Panel(explode.Segments)
end = EndPoints(Curve=explode.Segments)  # -> Start, End
pull = PullPoint(Point=end.End, Geometry=superlots_2, ClosestOnly=True)  # -> ClosestPoint, Distance
pull_2 = PullPoint(Point=end.Start, Geometry=superlots_2, ClosestOnly=True)  # -> ClosestPoint, Distance
number_slider = Slider(0.2, range=0..1)
eval = EvaluateCurve(Curve=reparameterize(explode.Segments), Parameter=0.5)  # -> Point, Tangent, Angle
crv_cp = CurveClosestPoint(Point=eval.Point, Curve=superlots_2)  # -> Point, Parameter, Distance
smaller = SmallerThan(FirstNumber=pull.Distance, SecondNumber=number_slider)  # -> graft(SmallerThan), OrEqualTo
smaller_2 = SmallerThan(FirstNumber=pull_2.Distance, SecondNumber=number_slider)  # -> graft(SmallerThan), OrEqualTo
smaller_3 = SmallerThan(FirstNumber=crv_cp.Distance, SecondNumber=Slider(0.3, range=0..1))  # -> graft(SmallerThan), OrEqualTo
panel_2 = Panel(smaller.SmallerThan)
ma = MassAddition(Input=[smaller_2.SmallerThan, smaller.SmallerThan, smaller_3.SmallerThan])  # -> Result, PartialResults
multi_dispatch = DispatchMultiple(List=graft(explode.Segments), DispatchPattern=ma.Result)  # -> Data0, Data1, Data2, Data3
weave = Weave(
    Pattern=ma.Result,
    Stream0=multi_dispatch.Data0,
    Stream1=multi_dispatch.Data1,
    Stream2=multi_dispatch.Data2,
    Stream3=multi_dispatch.Data3,
    NullGaps=False)  # -> simplify(Weave)
panel_3 = Panel(multi_dispatch.Data0)
trim = TrimTree(Tree=weave, Depth=1)
back = Curve(multi_dispatch.Data0)
sides = Curve([multi_dispatch.Data1, multi_dispatch.Data2])
tree = Curve(trim)
panel_4 = Panel(tree)
front = Curve(multi_dispatch.Data3)

# ---- group: Cluster Output
back_2 = ClusterOutput(back)

sides_2 = ClusterOutput(sides)

front_2 = ClusterOutput(front)

# ----
tree_2 = ClusterOutput(tree)
panel_5 = Panel(trim)

# ==== cluster CleanPolyline
crv = ClusterInput()
crv_2 = Curve(flatten(crv))
tolerance = ClusterInput()
crv_3 = Curve(simplify(graft(crv_2)))
tolerance_2 = Data(tolerance)
pcol = PolylineCollapse(Polyline=crv_3, Tolerance=tolerance_2)  # -> Polyline, Count
simplify = SimplifyCurve(Curve=pcol.Polyline, Tolerance=tolerance_2)  # -> Curve, Simplified
redpline = Reduce(Polyline=simplify.Curve, Tolerance=tolerance_2)  # -> Polyline, Reduction
line = Line(redpline.Polyline)
dispatch = Dispatch(List=redpline.Polyline, DispatchPattern=line)  # -> ListA, ListB
explode = Explode(Curve=dispatch.ListB, Recursive=True)  # -> Segments, Vertices
shift = ShiftList(List=explode.Segments, Shift=-1, Wrap=True)
flip = FlipCurve(Curve=shift)  # -> Curve, Flag
ln = Line()
angle = Angle(VectorA=explode.Segments, VectorB=flip.Curve)  # -> Angle, Reflex
dom = ConstructDomain(DomainStart=Slider(179, range=0..1000), DomainEnd=Slider(181, range=0..1000))
deg = Degrees(Radians=angle.Angle)
inc = Includes(Value=deg, Domain=dom)  # -> Includes, Deviation
cull = CullPattern(List=explode.Vertices, CullPattern=invert(inc.Includes))  # -> simplify(List)
cls = Closed(Curve=dispatch.ListB)  # -> simplify(graft(Closed)), Periodic
intcrv = Interpolate(Vertices=cull, Degree=1, Periodic=cls.Closed, KnotStyle=1)  # -> Curve, Length, Domain
merge = Merge(Data1=dispatch.ListA, Data2=intcrv.Curve)
pcol_2 = PolylineCollapse(Polyline=merge, Tolerance=tolerance_2)  # -> Polyline, Count
crv_4 = Curve(pcol_2.Polyline)
crv_5 = ClusterOutput(crv_4)
